% Simulink data dictionary kf_test.sldd
% references TUM_interfaces.sldd
% references mvdc_state_estimation.sldd

sim_time = 300

addNoise = Simulink.Parameter(1)  % addNoise : 1 - add Noise
  % addNoise:  0 - no Noise added

enable_VLOCPosValid = Simulink.Parameter(0, DataType="boolean")  % addNoise : 1 - add Noise
  % addNoise:  0 - no Noise added

enable_GPSPosValid = Simulink.Parameter(1, DataType="boolean")  % addNoise : 1 - add Noise
  % addNoise:  0 - no Noise added

enable_SensorFusion = Simulink.Parameter(1)  % addNoise : 1 - add Noise
  % addNoise:  0 - no Noise added