% Simulink data dictionary UDPPortConfig.sldd

TPARTSend_Port = 22111
V2XSend_Port = 3002
VisualLocalizationSend_Port = 44440
VisualLocalizationRcv_Port = 44441
BehaviorStatemachineRcv_Port = 47101
BehaviorStatemachineSend_Port = 47100
TrajectoryGenerationSend_Port = 47102
PerformanceTrajectoryRcv_Port = 47103
EmergencyPathRcv_Port = 47104
ControllerLearningSend_Port = 47105
LocalTrajPlannerSend_Port = 47106
ObjTrackingSend_Port = 47107
TrajectoryGenerationRcv_Port = 47108
MapReferencesRcv_Port = 47109
TPASend_Port = 47108
PerfTrajRatingRcv_Port = 47292
EmergTrajRatingRcv_Port = 47293
PerfTrajSafetyAssessmentSend_Port = 47290
EmergTrajSafetyAssessmentSend_Port = 47291
ModCtrl_VehSenDat_SendPort = 11002
ModCtrl_VehSysStat_SendPort = 11001
ModCtrl_ActLim_SendPort = 11000
ModCtrl_CtrlCommandVeh1_RcvPort = 10000
ModCtrl_CtrlCommandVeh2_RcvPort = 10001
ModCtrl_CtrlCommandVeh3_RcvPort = 10002
ModCtrl_CtrlCommandVeh4_RcvPort = 10003
ModMapLoc_VehSenDat_SendPort = 11003
ModObj_ObjList_SendPort = 11004
ModCtrl_CtrlCommandVeh5_RcvPort = 10004
ModCtrl_CtrlCommandVeh6_RcvPort = 10005
ModCtrl_CtrlCommandVeh7_RcvPort = 10006
ModCtrl_CtrlCommandVeh8_RcvPort = 10007
ModSens_GpsSenDat_SendPort = 3002
ModCtrl_RaptorCommandVeh1_RcvPort = 10010
ModCtrl_RaptorCommandVeh2_RcvPort = 10011
ModCtrl_RaptorCommandVeh3_RcvPort = 10012
ModCtrl_RaptorCommandVeh4_RcvPort = 10013
ModCtrl_RaptorCommandVeh5_RcvPort = 10014
ModCtrl_RaptorCommandVeh6_RcvPort = 10015
ModCtrl_RaptorCommandVeh7_RcvPort = 10016
ModCtrl_RaptorCommandVeh8_RcvPort = 10017
ModCtrl_RaptorState_SendPort = 11100