% Simulink data dictionary controller_dev_sg.sldd
% references TrajectoryPlanningEmulation.sldd
% references mvdc_vehicle_dynamics_control.sldd
% references PassengerVehicle.sldd
% references UDPPortConfig.sldd
% references mloc_debug_signal_conversion.sldd
% references convert_SimBus.sldd
% references RaptorStateMachine.sldd

tPX2CommsTimeout = Simulink.Parameter(0.3)
vehicleID_SpeedgoatScopes = Simulink.Parameter(1)
sensors_freq_radar = Simulink.Parameter(20)
sensors_freq_lidar = Simulink.Parameter(12)
sensors_freq_camera = Simulink.Parameter(37)
bool_activate_Vehicles = Simulink.Parameter([1 1 1 0 0 0 0 0 0 0], DataType="boolean")
sensors_freq_imu = Simulink.Parameter(100)
sensors_freq_gps = Simulink.Parameter(20)