% Simulink data dictionary modelconfig.sldd

tS_Speedgoat = 0.004
tS_RasperryPi = 0.02
tS_GRT = Simulink.Parameter(0.004)
tSV2X = Simulink.Parameter(0.002)
Speedgoat_Multiple = Simulink.ConfigSet(StartTime="0", StopTime="inf", FixedStep="tS", Solver="FixedStepDiscrete", ProdHWDeviceType="Generic->32-bit x86 compatible", SystemTargetFile="slrt.tlc", TargetLang="C")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
GRT_Multiple = Simulink.ConfigSet(StartTime="0", StopTime="inf", FixedStep="tS", Solver="FixedStepDiscrete", ProdHWDeviceType="Intel->x86-64 (Windows64)", SystemTargetFile="grt.tlc", TargetLang="C")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
tSSlow = 0.032
Speedgoat = Simulink.ConfigSet(StartTime="0", StopTime="inf", FixedStep="tS", Solver="FixedStepDiscrete", ProdHWDeviceType="Generic->32-bit x86 compatible", SystemTargetFile="slrt.tlc", TargetLang="C")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
GRT = Simulink.ConfigSet(StartTime="0", StopTime="inf", FixedStep="tS", Solver="FixedStepDiscrete", ProdHWDeviceType="Intel->x86-64 (Windows64)", SystemTargetFile="grt.tlc", TargetLang="C")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
Active = Simulink.ConfigSet(StartTime="0", StopTime="inf", FixedStep="tS", Solver="FixedStepDiscrete", ProdHWDeviceType="Intel->x86-64 (Windows64)", SystemTargetFile="grt.tlc", TargetLang="C")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
Active_Multiple = Simulink.ConfigSet(StartTime="0", StopTime="inf", FixedStep="tS", Solver="FixedStepDiscrete", ProdHWDeviceType="Intel->x86-64 (Windows64)", SystemTargetFile="grt.tlc", TargetLang="C")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
tS = Simulink.Parameter(0.004)