% Simulink data dictionary pa_mvdc_curvvel_tracking.sldd

P_VDC_LatDeltaMaxFB_rad = Simulink.Parameter(0.2, Min=0)
P_VDC_LatDeltaMinFB_rad = Simulink.Parameter(-0.2, Max=0)
P_VDC_EnterStandstillThreshhold_mps = Simulink.Parameter(0.8)
P_VDC_LatDeltaMaxFF_rad = Simulink.Parameter(0.35, Min=0)
P_VDC_LatDeltaMinFF_rad = Simulink.Parameter(-0.35, Max=0)
P_VDC_LatDeltaMaxDistComp_rad = Simulink.Parameter(0.1, Min=0)
P_VDC_LatDeltaMinDistComp_rad = Simulink.Parameter(-0.1, Max=0)
P_VDC_MaxSlopeDelta_radps = Simulink.Parameter(5)
P_VDC_MinSlopeDelta_radps = Simulink.Parameter(-5)
P_VDC_FxMaxDistComp_N = Simulink.Parameter(5000, Min=0)
P_VDC_FxMinDistComp_N = Simulink.Parameter(-5000, Max=0)
P_VDC_FxMaxFB_N = Simulink.Parameter(3000, Min=0)
P_VDC_FxMinFB_N = Simulink.Parameter(-3000, Max=0)
P_VDC_NegativeFxStandstill_N = Simulink.Parameter(-2000, Max=0)
P_VDC_LongKp = Simulink.Parameter(1000, Min=0)
P_VDC_FxMinSlope_Nps = Simulink.Parameter(-300000, Max=0)
P_VDC_FxMaxSlope_Nps = Simulink.Parameter(300000, Min=0)
P_VDC_FxMaxDistFF_N = Simulink.Parameter(6000, Min=0)
P_VDC_FxMinDistFF_N = Simulink.Parameter(-6000, Max=0)
P_VDC_EmergencyBrakeAcceleration_mps2 = Simulink.Parameter(-10, Max=0)
P_VDC_UndersteerCompensationLowPassActive_b = Simulink.Parameter(true, DataType="boolean")
P_VDC_UndersteerGradient = Simulink.Parameter(0.0016)
P_VDC_UndersteerCompensationActive_b = Simulink.Parameter(false, DataType="boolean")
P_VDC_LowPassUSCT1 = Simulink.Parameter(0.08)
P_VDC_VelCon_vMaxStatic_mps = Simulink.Parameter(70)
P_VDC_CurvKp = Simulink.Parameter(0.3, Min=0)
P_VDC_UseManualFF = Simulink.Parameter(false, DataType="boolean")
P_VDC_FullControlSpeed_mps = Simulink.Parameter(0.3)
P_VDC_SlowControlSpeed_mps = Simulink.Parameter(0, Min=0)
P_VDC_VelDistFBActive = Simulink.Parameter(true, DataType="boolean")
P_VDC_VelDistFFActive = Simulink.Parameter(true, DataType="boolean")
P_VDC_VelDistEst_PT1_s = Simulink.Parameter(1)
P_VDC_CurvDistEst_PT1_s = Simulink.Parameter(1)
P_VDC_CurvDistActive = Simulink.Parameter(true, DataType="boolean")
P_VDC_SCLearn_LengthScales = Simulink.Parameter([0.04 5])
P_VDC_SCLearn_Sigma = Simulink.Parameter(0.01)
P_VDC_SCLearn_FilterCoeff = Simulink.Parameter(0.995)
P_VDC_SCLearn_KappaMax_radpm = Simulink.Parameter(0.13)
P_VDC_SCLearn_vMax_mps = Simulink.Parameter(60)
P_VDC_NonlinCurvDeltaActive_b = Simulink.Parameter(false, DataType="boolean")
P_VDC_CurvNonlin_PT1For_s = Simulink.Parameter(0.1)
P_VDC_CurvNonlin_PT1Active = Simulink.Parameter(true, DataType="boolean")
P_VDC_VelDistEst_PT1For_s = Simulink.Parameter(0.1)
P_VDC_VelDistFB_PT1Active = Simulink.Parameter(true, DataType="boolean")
P_VDC_TCActiveSpeed_mps = Simulink.Parameter(5)
P_VDC_SlipFilterTC_s = Simulink.Parameter(0.05)
P_VDC_EnableTC = Simulink.Parameter(true, DataType="boolean")
P_VDC_TCReductionFactor = Simulink.Parameter(0.97)
P_VDC_TargetBrakeSlip_perc = Simulink.Parameter(-15)
P_VDC_TCMaxF_N = Simulink.Parameter(10000)
P_VDC_TC_Kp = Simulink.Parameter(20)
P_VDC_TC_Ki = Simulink.Parameter(0.25)
P_VDC_MaxAy_mps2 = Simulink.Parameter(15)
P_VDC_ActivateDynamicFxLimits = Simulink.Parameter(false, DataType="boolean")
P_VDC_MaxAx_mps2 = Simulink.Parameter(15)
P_VDC_SCPreload_Delta = repmat(0, 21, 15)

P_VDC_SCPreload_Kappa = [-0.13 -0.13 -0.13 -0.13 -0.13 -0.13 -0.13 -0.13 -0.13 -0.13 -0.13 -0.13 -0.13 -0.13 -0.13
 -0.117 -0.117 -0.117 -0.117 -0.117 -0.117 -0.117 -0.117 -0.117 -0.117 -0.117 -0.117 -0.117 -0.117 -0.117
 -0.104 -0.104 -0.104 -0.104 -0.104 -0.104 -0.104 -0.104 -0.104 -0.104 -0.104 -0.104 -0.104 -0.104 -0.104
 -0.091 -0.091 -0.091 -0.091 -0.091 -0.091 -0.091 -0.091 -0.091 -0.091 -0.091 -0.091 -0.091 -0.091 -0.091
 -0.078 -0.078 -0.078 -0.078 -0.078 -0.078 -0.078 -0.078 -0.078 -0.078 -0.078 -0.078 -0.078 -0.078 -0.078
 -0.065 -0.065 -0.065 -0.065 -0.065 -0.065 -0.065 -0.065 -0.065 -0.065 -0.065 -0.065 -0.065 -0.065 -0.065
 -0.052 -0.052 -0.052 -0.052 -0.052 -0.052 -0.052 -0.052 -0.052 -0.052 -0.052 -0.052 -0.052 -0.052 -0.052
 -0.039 -0.039 -0.039 -0.039 -0.039 -0.039 -0.039 -0.039 -0.039 -0.039 -0.039 -0.039 -0.039 -0.039 -0.039
 -0.026 -0.026 -0.026 -0.026 -0.026 -0.026 -0.026 -0.026 -0.026 -0.026 -0.026 -0.026 -0.026 -0.026 -0.026
 -0.013 -0.013 -0.013 -0.013 -0.013 -0.013 -0.013 -0.013 -0.013 -0.013 -0.013 -0.013 -0.013 -0.013 -0.013
 0 0 0 0 0 0 0 0 0 0 0 0 0 0 0
 0.013 0.013 0.013 0.013 0.013 0.013 0.013 0.013 0.013 0.013 0.013 0.013 0.013 0.013 0.013
 0.026 0.026 0.026 0.026 0.026 0.026 0.026 0.026 0.026 0.026 0.026 0.026 0.026 0.026 0.026
 0.039 0.039 0.039 0.039 0.039 0.039 0.039 0.039 0.039 0.039 0.039 0.039 0.039 0.039 0.039
 0.052 0.052 0.052 0.052 0.052 0.052 0.052 0.052 0.052 0.052 0.052 0.052 0.052 0.052 0.052
 0.065 0.065 0.065 0.065 0.065 0.065 0.065 0.065 0.065 0.065 0.065 0.065 0.065 0.065 0.065
 0.078 0.078 0.078 0.078 0.078 0.078 0.078 0.078 0.078 0.078 0.078 0.078 0.078 0.078 0.078
 0.091 0.091 0.091 0.091 0.091 0.091 0.091 0.091 0.091 0.091 0.091 0.091 0.091 0.091 0.091
 0.104 0.104 0.104 0.104 0.104 0.104 0.104 0.104 0.104 0.104 0.104 0.104 0.104 0.104 0.104
 0.117 0.117 0.117 0.117 0.117 0.117 0.117 0.117 0.117 0.117 0.117 0.117 0.117 0.117 0.117
 0.13 0.13 0.13 0.13 0.13 0.13 0.13 0.13 0.13 0.13 0.13 0.13 0.13 0.13 0.13]

P_VDC_SCPreload_Vel = [0 4.285714 8.571429 12.85714 17.14286 21.42857 25.71429 30 34.28571 38.57143 42.85714 47.14286 51.42857 55.71429 60
 0 4.285714 8.571429 12.85714 17.14286 21.42857 25.71429 30 34.28571 38.57143 42.85714 47.14286 51.42857 55.71429 60
 0 4.285714 8.571429 12.85714 17.14286 21.42857 25.71429 30 34.28571 38.57143 42.85714 47.14286 51.42857 55.71429 60
 0 4.285714 8.571429 12.85714 17.14286 21.42857 25.71429 30 34.28571 38.57143 42.85714 47.14286 51.42857 55.71429 60
 0 4.285714 8.571429 12.85714 17.14286 21.42857 25.71429 30 34.28571 38.57143 42.85714 47.14286 51.42857 55.71429 60
 0 4.285714 8.571429 12.85714 17.14286 21.42857 25.71429 30 34.28571 38.57143 42.85714 47.14286 51.42857 55.71429 60
 0 4.285714 8.571429 12.85714 17.14286 21.42857 25.71429 30 34.28571 38.57143 42.85714 47.14286 51.42857 55.71429 60
 0 4.285714 8.571429 12.85714 17.14286 21.42857 25.71429 30 34.28571 38.57143 42.85714 47.14286 51.42857 55.71429 60
 0 4.285714 8.571429 12.85714 17.14286 21.42857 25.71429 30 34.28571 38.57143 42.85714 47.14286 51.42857 55.71429 60
 0 4.285714 8.571429 12.85714 17.14286 21.42857 25.71429 30 34.28571 38.57143 42.85714 47.14286 51.42857 55.71429 60
 0 4.285714 8.571429 12.85714 17.14286 21.42857 25.71429 30 34.28571 38.57143 42.85714 47.14286 51.42857 55.71429 60
 0 4.285714 8.571429 12.85714 17.14286 21.42857 25.71429 30 34.28571 38.57143 42.85714 47.14286 51.42857 55.71429 60
 0 4.285714 8.571429 12.85714 17.14286 21.42857 25.71429 30 34.28571 38.57143 42.85714 47.14286 51.42857 55.71429 60
 0 4.285714 8.571429 12.85714 17.14286 21.42857 25.71429 30 34.28571 38.57143 42.85714 47.14286 51.42857 55.71429 60
 0 4.285714 8.571429 12.85714 17.14286 21.42857 25.71429 30 34.28571 38.57143 42.85714 47.14286 51.42857 55.71429 60
 0 4.285714 8.571429 12.85714 17.14286 21.42857 25.71429 30 34.28571 38.57143 42.85714 47.14286 51.42857 55.71429 60
 0 4.285714 8.571429 12.85714 17.14286 21.42857 25.71429 30 34.28571 38.57143 42.85714 47.14286 51.42857 55.71429 60
 0 4.285714 8.571429 12.85714 17.14286 21.42857 25.71429 30 34.28571 38.57143 42.85714 47.14286 51.42857 55.71429 60
 0 4.285714 8.571429 12.85714 17.14286 21.42857 25.71429 30 34.28571 38.57143 42.85714 47.14286 51.42857 55.71429 60
 0 4.285714 8.571429 12.85714 17.14286 21.42857 25.71429 30 34.28571 38.57143 42.85714 47.14286 51.42857 55.71429 60
 0 4.285714 8.571429 12.85714 17.14286 21.42857 25.71429 30 34.28571 38.57143 42.85714 47.14286 51.42857 55.71429 60]

P_VDC_UsePreloadedSC = Simulink.Parameter(false, DataType="boolean")
P_VDC_CurvNonlinFilter_s = Simulink.Parameter(0.07)
P_VDC_SCLearn_FilterCoeff1 = Simulink.Parameter(0.999)
P_VDC_FxMaxFF_N = Simulink.Parameter(20000, Min=0)
P_VDC_FxMinFF_N = Simulink.Parameter(-20000, Max=0)