% Simulink data dictionary pa_mvdc_disturbance_learning.sldd

alg_mean_ax = struct(gamma=2.0e-5, mu=10, w=[0; 0], N=2500, count=0, delta_w_temp=[0; 0])
alg_mean_ay = struct(mu=10, N=2500, count=0, delta_w_temp=[0; 0], gamma=2.0e-5, w=[0; 0])
alg_quantile_ax_lower = struct(r_est=-3.5, q_target=0.05, lambda=1, N=2500, count_lower=0, count=0)
alg_quantile_ax_upper = struct(r_est=3.5, q_target=0.95, lambda=1, N=2500, count_lower=0, count=0)
alg_quantile_ay_lower = struct(r_est=-3.5, q_target=0.05, lambda=1, N=2500, count_lower=0, count=0)
alg_quantile_ay_upper = struct(r_est=3.5, q_target=0.95, lambda=1, N=2500, count_lower=0, count=0)