% Simulink data dictionary pa_mvdc_exactlin_feedback.sldd

P_VDC_EL_FxStandstill_N = Simulink.Parameter(-2500)
P_VDC_EL_vFullControl_mps = Simulink.Parameter(16)
P_VDC_EL_LatControl_w_0 = Simulink.Parameter(3)
P_VDC_LatControl_D = Simulink.Parameter(1)
P_VDC_LongControl_Kp = Simulink.Parameter(1)
P_VDC_EL_c_R_N = Simulink.Parameter(6400)
P_VDC_EL_c_1prad = Simulink.Parameter(35)
P_VDC_EL_alphaMax_rad = Simulink.Parameter(0.35)
P_VDC_EL_axMaxFB_mps2 = Simulink.Parameter(2)
P_VDC_EL_c_F_N = Simulink.Parameter(6000)