% Simulink data dictionary pa_mvdc_mpc.sldd

P_VDC_LogTubeData = Simulink.Parameter(false, DataType="boolean")
P_VDC_MaxSpeedTMPC_mps = Simulink.Parameter(100)
P_VDC_TMPCEnableUSLearning = Simulink.Parameter(false, DataType="boolean")
P_VDC_TMPCMaxSolverIter = Simulink.Parameter(200)
P_VDC_VirtualController = Simulink.Parameter([-2.1383 0 0; 0 -4.2124 -2.988])
P_VDC_UncertaintyLearningGain = Simulink.Parameter(1.0e-6)
P_VDC_UncertaintyTarget_perc = Simulink.Parameter(90)
P_VDC_EnableUncertaintyLearning = Simulink.Parameter(false, DataType="boolean")
P_VDC_UncertaintyLearningReg = Simulink.Parameter(1)
P_VDC_UncertaintyLearningSamples = Simulink.Parameter(1000)
P_VDC_axFFModelLearningReg = Simulink.Parameter(1000)
P_VDC_ayFFModelLearningReg = Simulink.Parameter(1)
P_VDC_axFFModelLearningRate = Simulink.Parameter(0)
P_VDC_ayFFModelLearningRate = Simulink.Parameter(0)
P_VDC_LatAcc_FF_Ts = Simulink.Parameter(0.08)
P_VDC_LongAcc_FF_Ts = Simulink.Parameter(0.08)
P_VDC_axFFModelLearningEnable = Simulink.Parameter(false, DataType="boolean")
P_VDC_ayFFModelLearningEnable = Simulink.Parameter(false, DataType="boolean")
P_VDC_EnableYawRateAccRepl = Simulink.Parameter(false, DataType="boolean")
P_VDC_LongAcc_FB_Ts = Simulink.Parameter(0.08)
P_VDC_LatAccKp_Delta = Simulink.Parameter(0)
P_VDC_LatAcc_VehicleDynamics_Ts = Simulink.Parameter(0.1)
P_VDC_LatAcc_Steering_Ts = Simulink.Parameter(0.04)
P_VDC_RTISQP_alpha_old = Simulink.Parameter(0.4)
P_VDC_RTISQP_alpha_target = Simulink.Parameter(0.3)
P_VDC_axLim_scale = Simulink.Parameter(1)
P_VDC_ayLim_scale = Simulink.Parameter(1)
P_VDC_TerminalSetBrakeTime_s = Simulink.Parameter(0.5)
P_VDC_LongAcc_LimFb_N = Simulink.Parameter(1000)

acc_control_learning = struct(
  spread_vx_mps=[10 25 40 55 70 85 100],
  spread_ay_req_mps2=[-36 -30 -24 -18 -12 -6 0 6 12 18 24 30 36],
  vx_width_mps=20,
  ay_width_mps2=8,
  bf_vx_mps=[10; 10; 10; 10; 10; 10; 10; 10; 10; 10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 100],
  bf_ay_req_mps2=[-36; -30; -24; -18; -12; -6; 0; 6; 12; 18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 36],
  w0=[8.221824e-17; 3.755125e-14; 5.571013e-12; 2.683905e-10; 4.197798e-09; 2.131117e-08; 3.511039e-08; 1.87682e-08; 3.254793e-09; 1.832424e-10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 0.0001822919])

P_VDC_StabilizerRearSideSlip_rad = Simulink.Parameter(0.1)
P_VDC_EnableNumLatErrorDer_b = Simulink.Parameter(false, DataType="boolean")
P_VDC_MaxTightening = Simulink.Parameter(0.9)
P_VDC_TuneTerminalSet_mps = Simulink.Parameter(1)
P_VDC_SteeringSteadyStateUndersteerComp_rad = 0
P_VDC_LatAcc_UndersteerComp_Ts = 0.1
P_VDC_SteeringOvalComp_rad = Simulink.Parameter(0)

sys = struct(
  dummy="ForceInline",
  Q=[0.02 0 0; 0 0.1 0; 0 0 40],
  R=[0.01 0; 0 0.005],
  roh_u=1,
  roh_x=1,
  roh_lin=1000,
  roh_quad=100,
  rdiff_ax=0.1,
  rdiff_ay=200,
  r_ax=0,
  slack_lim_rel=0.05,
  trigger_print=0,
  trigger_Pupdate=0,
  use_scale_units=0,
  use_constr_precision=0,
  N_hor=40,
  Ts=0.06,
  A_d=[1 0 0; 0 1 0.06; 0 0 1],
  B_d=[0.06 0; 0 0; 0 0.06],
  n_sys=3,
  m_sys=2,
  S_LQR=[0.2459143 -3.619836e-15 -1.9081e-16; -3.619836e-15 33.48672 2.07029; -1.9081e-16 2.07029 41.47213],
  K_LQR=[-1.355486 1.990183e-14 1.228191e-15; 6.816281e-17 -0.8050401 -16.17489],
  M_1=[1.0e-8 0 0; 0 1.0e-8 0; 0 0 1.0e-8],
  n_constr=5,
  n_slacks=4,
  ns_total=160,
  S_lin_slack=[1000; 1000; 1000; 1000],
  S_quad_slack=[100 0 0 0; 0 100 0 0; 0 0 100 0; 0 0 0 100],
  ABK_MPC=[0 0 0 0 0 0 0 0 0 0 0 0 0 0 0 0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
   0 0 0 0 0 0 0 0 0 0 0 0 0 0 0 0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
   0 0 0 0 0 0 0 0 0 0 0 0 0 0 0 0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
   0.06 0 0 0 0 0 0 0 0 0 0 0 0 0 0 0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
   0 0 0 0 0 0 0 0 0 0 0 0 0 0 0 0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
   0 0.06 0 0 0 0 0 0 0 0 0 0 0 0 0 0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
   0.06 0 0.06 0 0 0 0 0 0 0 0 0 0 0 0 0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
   0 0.0036 0 0 0 0 0 0 0 0 0 0 0 0 0 0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
   0 0.06 0 0.06 0 0 0 0 0 0 0 0 0 0 0 0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
   0.06 0 0.06 0 0.06 0 0 0 0 0 0 0 0 0 0 0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   ],
  Ax0_MPC=[1 0 0
   0 1 0
   0 0 1
   1 0 0
   0 1 0.06
   0 0 1
   1 0 0
   0 1 0.12
   0 0 1
   1 0 0
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   ],
  H_states=[0.007386583 -6.236083e-17 0.007242583 -6.079707e-17 0.007098583 -5.92333e-17 0.006954583 -5.766953e-17 0.006810583 -5.610576e-17 0.006666583 -5.454199e-17 0.006522583 -5.297822e-17 0.006378583 -5.141445e-17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
   -6.236083e-17 12.96985 -6.236083e-17 12.64518 -6.236083e-17 12.32052 -6.236083e-17 11.99586 -6.236083e-17 11.67121 -6.236083e-17 11.34657 -6.236083e-17 11.02194 -6.236083e-17 10.69733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
   0.007242583 -6.236083e-17 0.007242583 -6.079707e-17 0.007098583 -5.92333e-17 0.006954583 -5.766953e-17 0.006810583 -5.610576e-17 0.006666583 -5.454199e-17 0.006522583 -5.297822e-17 0.006378583 -5.141445e-17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
   -6.079707e-17 12.64518 -6.079707e-17 12.60948 -6.079707e-17 12.28578 -6.079707e-17 11.96209 -6.079707e-17 11.63839 -6.079707e-17 11.31471 -6.079707e-17 10.99104 -6.079707e-17 10.66738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
   0.007098583 -6.236083e-17 0.007098583 -6.079707e-17 0.007098583 -5.92333e-17 0.006954583 -5.766953e-17 0.006810583 -5.610576e-17 0.006666583 -5.454199e-17 0.006522583 -5.297822e-17 0.006378583 -5.141445e-17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
   -5.92333e-17 12.32052 -5.92333e-17 12.28578 -5.92333e-17 12.25105 -5.92333e-17 11.92831 -5.92333e-17 11.60558 -5.92333e-17 11.28285 -5.92333e-17 10.96013 -5.92333e-17 10.63742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
   0.006954583 -6.236083e-17 0.006954583 -6.079707e-17 0.006954583 -5.92333e-17 0.006954583 -5.766953e-17 0.006810583 -5.610576e-17 0.006666583 -5.454199e-17 0.006522583 -5.297822e-17 0.006378583 -5.141445e-17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
   -5.766953e-17 11.99586 -5.766953e-17 11.96209 -5.766953e-17 11.92831 -5.766953e-17 11.89454 -5.766953e-17 11.57276 -5.766953e-17 11.25099 -5.766953e-17 10.92922 -5.766953e-17 10.60747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
   0.006810583 -6.236083e-17 0.006810583 -6.079707e-17 0.006810583 -5.92333e-17 0.006810583 -5.766953e-17 0.006810583 -5.610576e-17 0.006666583 -5.454199e-17 0.006522583 -5.297822e-17 0.006378583 -5.141445e-17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
   -5.610576e-17 11.67121 -5.610576e-17 11.63839 -5.610576e-17 11.60558 -5.610576e-17 11.57276 -5.610576e-17 11.53995 -5.610576e-17 11.21913 -5.610576e-17 10.89832 -5.610576e-17 10.57751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   ],
  H_inputs=[0.02 0 0 0 0 0 0 0 0 0 0 0 0 0 0 0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
   0 0.01 0 0 0 0 0 0 0 0 0 0 0 0 0 0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
   0 0 0.02 0 0 0 0 0 0 0 0 0 0 0 0 0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
   0 0 0 0.01 0 0 0 0 0 0 0 0 0 0 0 0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
   0 0 0 0 0.02 0 0 0 0 0 0 0 0 0 0 0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
   0 0 0 0 0 0.01 0 0 0 0 0 0 0 0 0 0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
   0 0 0 0 0 0 0.02 0 0 0 0 0 0 0 0 0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
   0 0 0 0 0 0 0 0.01 0 0 0 0 0 0 0 0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
   0 0 0 0 0 0 0 0 0.02 0 0 0 0 0 0 0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
   0 0 0 0 0 0 0 0 0 0.01 0 0 0 0 0 0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   ],
  H_reg=[0.4 0 -0.2 0 0 0 0 0 0 0 0 0 0 0 0 0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
   0 800 0 -400 0 0 0 0 0 0 0 0 0 0 0 0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
   -0.2 0 0.4 0 -0.2 0 0 0 0 0 0 0 0 0 0 0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
   0 -400 0 800 0 -400 0 0 0 0 0 0 0 0 0 0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
   0 0 -0.2 0 0.4 0 -0.2 0 0 0 0 0 0 0 0 0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
   0 0 0 -400 0 800 0 -400 0 0 0 0 0 0 0 0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
   0 0 0 0 -0.2 0 0.4 0 -0.2 0 0 0 0 0 0 0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
   0 0 0 0 0 -400 0 800 0 -400 0 0 0 0 0 0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
   0 0 0 0 0 0 -0.2 0 0.4 0 -0.2 0 0 0 0 0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
   0 0 0 0 0 0 0 -400 0 800 0 -400 0 0 0 0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   ],
  H_slacks=[0 0 0 0 0 0 0 0 0 0 0 0 0 0 0 0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
   0 0 0 0 0 0 0 0 0 0 0 0 0 0 0 0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
   0 0 0 0 0 0 0 0 0 0 0 0 0 0 0 0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
   0 0 0 0 0 0 0 0 0 0 0 0 0 0 0 0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
   0 0 0 0 0 0 0 0 0 0 0 0 0 0 0 0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
   0 0 0 0 0 0 0 0 0 0 0 0 0 0 0 0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
   0 0 0 0 0 0 0 0 0 0 0 0 0 0 0 0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
   0 0 0 0 0 0 0 0 0 0 0 0 0 0 0 0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
   0 0 0 0 0 0 0 0 0 0 0 0 0 0 0 0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
   0 0 0 0 0 0 0 0 0 0 0 0 0 0 0 0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   ],
  f_Dax=[-0.1 0 0 0 0 0 0 0 0 0 0 0 0 0 0 0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
   0.2 0 -0.1 0 0 0 0 0 0 0 0 0 0 0 0 0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
   -0.1 0 0.2 0 -0.1 0 0 0 0 0 0 0 0 0 0 0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
   0 0 -0.1 0 0.2 0 -0.1 0 0 0 0 0 0 0 0 0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
   0 0 0 0 -0.1 0 0.2 0 -0.1 0 0 0 0 0 0 0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
   0 0 0 0 0 0 -0.1 0 0.2 0 -0.1 0 0 0 0 0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
   0 0 0 0 0 0 0 0 -0.1 0 0.2 0 -0.1 0 0 0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
   0 0 0 0 0 0 0 0 0 0 -0.1 0 0.2 0 -0.1 0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
   0 0 0 0 0 0 0 0 0 0 0 0 -0.1 0 0.2 0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
   0 0 0 0 0 0 0 0 0 0 0 0 0 0 -0.1 0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   ],
  f_Day=[0 -200 0 0 0 0 0 0 0 0 0 0 0 0 0 0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
   0 400 0 -200 0 0 0 0 0 0 0 0 0 0 0 0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
   0 -200 0 400 0 -200 0 0 0 0 0 0 0 0 0 0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
   0 0 0 -200 0 400 0 -200 0 0 0 0 0 0 0 0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
   0 0 0 0 0 -200 0 400 0 -200 0 0 0 0 0 0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
   0 0 0 0 0 0 0 -200 0 400 0 -200 0 0 0 0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
   0 0 0 0 0 0 0 0 0 -200 0 400 0 -200 0 0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
   0 0 0 0 0 0 0 0 0 0 0 -200 0 400 0 -200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
   0 0 0 0 0 0 0 0 0 0 0 0 0 -200 0 400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
   0 0 0 0 0 0 0 0 0 0 0 0 0 0 0 -200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   ],
  f_x0=[0 0 0 0 0 0 0 0 0 0 0 0 0 0 0 0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
   0 0 0 0 0 0 0 0 0 0 0 0 0 0 0 0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
   0 0 0 0 0 0 0 0 0 0 0 0 0 0 0 0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
   0.0012 0 0 0 0 0 0 0 0 0 0 0 0 0 0 0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
   0 0 0 0 0 0 0 0 0 0 0 0 0 0 0 0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
   0 2.4 0 0 0 0 0 0 0 0 0 0 0 0 0 0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
   0.0012 0 0.0012 0 0 0 0 0 0 0 0 0 0 0 0 0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
   0 0.00036 0 0 0 0 0 0 0 0 0 0 0 0 0 0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
   0 2.4 0 2.4 0 0 0 0 0 0 0 0 0 0 0 0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
   0.0012 0 0.0012 0 0.0012 0 0 0 0 0 0 0 0 0 0 0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   ],
  f_D_deltaax=[-0.1 0 0 0 0 0 0 0 0 0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 0],
  f_D_deltaay=[0 -200 0 0 0 0 0 0 0 0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 0],
  f_d_m=[0 0 0 0 0 0 0 0 0 0 0 0 0 0 0 0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
   0 0 0 0 0 0 0 0 0 0 0 0 0 0 0 0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
   0 0.00036 0 0 0 0 0 0 0 0 0 0 0 0 0 0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
   0 0.00072 0 0.00036 0 0 0 0 0 0 0 0 0 0 0 0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
   0 0.00108 0 0.00072 0 0.00036 0 0 0 0 0 0 0 0 0 0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
   0 0.00144 0 0.00108 0 0.00072 0 0.00036 0 0 0 0 0 0 0 0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
   0 0.0018 0 0.00144 0 0.00108 0 0.00072 0 0.00036 0 0 0 0 0 0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
   0 0.00216 0 0.0018 0 0.00144 0 0.00108 0 0.00072 0 0.00036 0 0 0 0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
   0 0.00252 0 0.00216 0 0.0018 0 0.00144 0 0.00108 0 0.00072 0 0.00036 0 0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
   0 0.00288 0 0.00252 0 0.00216 0 0.0018 0 0.00144 0 0.00108 0 0.00072 0 0.00036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   ],
  f_dot_d_mps=[0 0 0 0 0 0 0 0 0 0 0 0 0 0 0 0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
   0 2.4 0 0 0 0 0 0 0 0 0 0 0 0 0 0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
   0 2.4 0 2.4 0 0 0 0 0 0 0 0 0 0 0 0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
   0 2.4 0 2.4 0 2.4 0 0 0 0 0 0 0 0 0 0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
   0 2.4 0 2.4 0 2.4 0 2.4 0 0 0 0 0 0 0 0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
   0 2.4 0 2.4 0 2.4 0 2.4 0 2.4 0 0 0 0 0 0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
   0 2.4 0 2.4 0 2.4 0 2.4 0 2.4 0 2.4 0 0 0 0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
   0 2.4 0 2.4 0 2.4 0 2.4 0 2.4 0 2.4 0 2.4 0 0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
   0 2.4 0 2.4 0 2.4 0 2.4 0 2.4 0 2.4 0 2.4 0 2.4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
   0 2.4 0 2.4 0 2.4 0 2.4 0 2.4 0 2.4 0 2.4 0 2.4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   ],
  n_constr_total=365,
  n_opt_total=242,
  osqp_m=365,
  osqp_n=242,
  A_ineq=[1 1 0 0 0 0 0 0 0 0 0 0 0 0 0 0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
   1 1 0 0 0 0 0 0 0 0 0 0 0 0 0 0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
   1 1 0 0 0 0 0 0 0 0 0 0 0 0 0 0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
   1 1 0 0 0 0 0 0 0 0 0 0 0 0 0 0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
   0 0 0 0 0 0 0 0 0 0 0 0 0 0 0 0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
   1 1 1 1 0 0 0 0 0 0 0 0 0 0 0 0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
   1 1 1 1 0 0 0 0 0 0 0 0 0 0 0 0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
   1 1 1 1 0 0 0 0 0 0 0 0 0 0 0 0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
   1 1 1 1 0 0 0 0 0 0 0 0 0 0 0 0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
   0 0 0 0 0 0 0 0 0 0 0 0 0 0 0 0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   ],
  l_par=repmat(-Inf, 365, 1),
  u_par=repmat(Inf, 365, 1),
  osqp_qpar=[0; 0; 0; 0; 0; 0; 0; 0; 0; 0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 1000],
  P_nnz=1804,
  P_i_lin=[1 244 485 487 728 730 969 971 973 1212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 58564],
  P_i_par=[0 1 0 2 1 3 0 2 4 1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 241],
  P_p_par=[0 1 2 4 6 9 12 16 20 25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 1804],
  A_nnz=7742,
  A_i_lin=[1 2 3 4 6 7 8 9 11 12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 88330],
  A_x_par=[1 1 1 1 1 1 1 1 1 1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 1],
  A_i_par=[0 1 2 3 5 6 7 8 10 11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 364],
  A_p_par=[0 161 361 518 713 866 1056 1205 1390 1535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 7742],
  P_par=[0.4273866 0 -0.1927574 0 0.007098583 0 0.006954583 0 0.006810583 0 0.006666583 0 0.006522583 0 0.006378583 0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
   0 812.9798 0 -387.3548 0 12.32052 0 11.99586 0 11.67121 0 11.34657 0 11.02194 0 10.69733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
   -0.1927574 0 0.4272426 0 -0.1929014 0 0.006954583 0 0.006810583 0 0.006666583 0 0.006522583 0 0.006378583 0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
   0 -387.3548 0 812.6195 0 -387.7142 0 11.96209 0 11.63839 0 11.31471 0 10.99104 0 10.66738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
   0.007098583 0 -0.1929014 0 0.4270986 0 -0.1930454 0 0.006810583 0 0.006666583 0 0.006522583 0 0.006378583 0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
   0 12.32052 0 -387.7142 0 812.261 0 -388.0717 0 11.60558 0 11.28285 0 10.96013 0 10.63742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
   0.006954583 0 0.006954583 0 -0.1930454 0 0.4269546 0 -0.1931894 0 0.006666583 0 0.006522583 0 0.006378583 0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
   0 11.99586 0 11.96209 0 -388.0717 0 811.9045 0 -388.4272 0 11.25099 0 10.92922 0 10.60747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
   0.006810583 0 0.006810583 0 0.006810583 0 -0.1931894 0 0.4268106 0 -0.1933334 0 0.006522583 0 0.006378583 0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
   0 11.67121 0 11.63839 0 11.60558 0 -388.4272 0 811.5499 0 -388.7809 0 10.89832 0 10.57751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   ],
  P_x_par=[0.4273866 812.9798 -0.1927574 0.4272426 -387.3548 812.6195 0.007098583 -0.1929014 0.4270986 12.32052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 200])

P_VDC_ControlMargin_ax_mps2 = Simulink.Parameter(2.5)
P_VDC_ControlMargin_ay_mps2 = Simulink.Parameter(2.5)
P_VDC_Dist_ax_perc = Simulink.Parameter(3)
P_VDC_Dist_ay_perc = Simulink.Parameter(6)
P_VDC_EnableRecalcTargetDeviation = Simulink.Parameter(true, DataType="boolean")
P_VDC_EnableTubeMPC = Simulink.Parameter(true, DataType="boolean")
P_VDC_LatAcc_BetaGain = Simulink.Parameter(0)
P_VDC_LatAcc_EnableForesightFF = Simulink.Parameter(false, DataType="boolean")
P_VDC_IncreaseUncertaintyPerStep_perc = Simulink.Parameter(0.08)
P_VDC_LatAccKi = Simulink.Parameter(3)
P_VDC_LatAccKi_Lim_perc = Simulink.Parameter(170)
P_VDC_LatAccKp_ay = Simulink.Parameter(1.2)
P_VDC_LatErrorDer_Ts_s = Simulink.Parameter(0.05)
P_VDC_LongAcc_EnableForesightFF = Simulink.Parameter(false, DataType="boolean")
P_VDC_LongAccKp = Simulink.Parameter(50)
P_VDC_MaxAccelLatError_mps2 = Simulink.Parameter(5)
P_VDC_PositiveAxLimScale = Simulink.Parameter(0.75)