% Simulink data dictionary pa_mvdc_path_feedback.sldd

P_VDC_ControlMaxSpeed_mps = Simulink.Parameter(60, Min=0)
P_VDC_ControlMinSpeed_mps = Simulink.Parameter(0, Max=0)
P_VDC_MinSpeedGainCorrection_mps = Simulink.Parameter(16)
P_VDC_KappaFFPathFeedback_Ts = Simulink.Parameter(0.03)
P_VDC_ActivateBetaCompensation = Simulink.Parameter(true, DataType="boolean")
P_VDC_UseBetaFeedback = Simulink.Parameter(true, DataType="boolean")
P_VDC_KappaT1_s = Simulink.Parameter(0.03)
P_VDC_ActivateKappaFFPT1 = Simulink.Parameter(false, DataType="boolean")
P_VDC_BarrierEmergency_radpm = Simulink.Parameter(0.06)
P_VDC_BarrierCorrectionGain_radpmpm = Simulink.Parameter(0.05)
P_VDC_BarriersCorrectionPT1_s = Simulink.Parameter(0.1)
P_VDC_ActivateBarriersCorrection_b = Simulink.Parameter(false, DataType="boolean")
P_VDC_ActivateKappaDynamicFF_b = Simulink.Parameter(false, DataType="boolean")
P_VDC_MinBarrierDistance_m = Simulink.Parameter(1.6)
P_VDC_CorrectionBarrierDistance_m = Simulink.Parameter(2.1)
P_VDC_LongFF_PT1_s = Simulink.Parameter(0.03)
P_VDC_UseLongFF_PT1_b = Simulink.Parameter(true, DataType="boolean")
P_VDC_NumDerivativeTFilter_s = Simulink.Parameter(0.05)
P_VDC_UseNumDerivativePathFeedback_b = Simulink.Parameter(false, DataType="boolean")
P_VDC_ActivateKappaFFFIR = Simulink.Parameter(false, DataType="boolean")
P_VDC_LatKappaMaxFB_radpm = Simulink.Parameter(0.1)
P_VDC_LatKappaMinFB_radpm = Simulink.Parameter(-0.1)
P_VDC_LatDamping = Simulink.Parameter(0.6, Min=0)
P_VDC_UseSSCDynamicsComp_b = Simulink.Parameter(true, DataType="boolean")
P_VDC_LatConvergence = Simulink.Parameter(2, Min=0)
P_VDC_UseWatchdogExternalControlParam = Simulink.Parameter(true, DataType="boolean")
P_VDC_UseExternalControllerParam = Simulink.Parameter(false, DataType="boolean")