% Simulink data dictionary pa_mvdc_path_matching.sldd

P_VDC_PathMatchInterpPoints = Simulink.Parameter(400, Min=100, Max=1000)
P_VDC_PowertrainForesight_s = Simulink.Parameter(0.06)
P_VDC_PathMatchingTimeOut = Simulink.Parameter(0.5)
P_VDC_CurvatureForesight_s = Simulink.Parameter(0.004)
P_VDC_SmoothPathWeights_LatDeviation = Simulink.Parameter(1)
P_VDC_SmoothPathWeights_DeltaCurvature = Simulink.Parameter(0.01)
P_VDC_PathMatchForesight_m = Simulink.Parameter(10)
P_VDC_SmoothPathActive_b = Simulink.Parameter(false, DataType="boolean")
P_VDC_HighPathDeviationDebounce = Simulink.Parameter(75)
P_VDC_LateralPathDeviationMax_m = Simulink.Parameter(3)
P_VDC_HeadingPathDeviationMax_rad = Simulink.Parameter(0.5)
P_VDC_ActivateHighPathDeviationDetection_b = Simulink.Parameter(true, DataType="boolean")
P_VDC_LocalFFCalculationActive_b = Simulink.Parameter(false, DataType="boolean")