% Simulink data dictionary pa_mvdc_trajectory_driver.sldd

P_VDC_MaxSlopeDelta_radps = Simulink.Parameter(5)
P_VDC_FxMaxSlope_Nps = Simulink.Parameter(1000000, Min=0)
P_VDC_NegativeFxStandstill_N = Simulink.Parameter(-2000, Max=0)
P_VDC_EnableTC = Simulink.Parameter(true, DataType="boolean")
P_VDC_SlipFilterTC_s = Simulink.Parameter(0.05)
P_VDC_TCReductionFactor = Simulink.Parameter(0.95)
P_VDC_TC_TargetSlip_perc = Simulink.Parameter(-10)
P_VDC_TCMaxF_N = Simulink.Parameter(25000)
P_VDC_TC_Kp = Simulink.Parameter(40)
P_VDC_TC_Ki = Simulink.Parameter(0.3)
P_VDC_DyLim = Simulink.Parameter(1, DataType="double")
P_VDC_ControllerChoice = 3
P_VDC_MaxRearSlip_rad = Simulink.Parameter(0.3)
P_MLOC_SafeForTakeOver_vabsMax_mps = Simulink.Parameter(0.8)
P_MLOC_SafeForTakeOver_FMax_N = Simulink.Parameter(-1000)
P_VDC_YawRateDiagSafetyFactor = Simulink.Parameter(1.2)
P_VDC_EngineLimit_Ts = Simulink.Parameter(0.05)
P_VDC_MaxThrottleLowSpeed = Simulink.Parameter(1)
P_VDC_steering_delta_FF_offfset = repmat(0, 1, 10)
P_VDC_steering_delta_FB_Kd = 0
P_VDC_steering_delta_FB_active = 0
P_VDC_steering_delta_FF_active = 0
P_VDC_steering_delta_FB_Kp = 0
P_VDC_steering_delta_FB_Ki = 0
P_VDC_steering_delta_lowspeeddamping_speed = 0
P_VDC_steering_delta_lowspeeddamping_velocity_factor = 3
P_VDC_steering_delta_controller_velocity_factor = 6
P_VDC_steering_delta_FB_error_Ts = 0.03
P_VDC_steering_delta_FF_breakpoints = [-10 -5 0 5 10 15 20 25 30 35]
P_VDC_steering_delta_lowspeeddamping_Ts = 0.01