% Simulink data dictionary pa_mloc_estimation_postprocessing.sldd

P_MLOC_OdometrySwitchSpeed_mps = Simulink.Parameter(2)
P_MLOC_VLOCManualReset_x_m = Simulink.Parameter(50)
P_MLOC_VLOCManualReset_y_m = Simulink.Parameter(100)
P_MLOC_VLOCManualReset_psi_rad = Simulink.Parameter(0)
P_MLOC_OdometryMode = Simulink.Parameter(3)
P_MLOC_VLOCResetMode = Simulink.Parameter(3)
P_VDC_ResidualsDebounceCounterPositionMax = Simulink.Parameter(125)
P_VDC_ResidualsDebounceCounterVelocityMax = Simulink.Parameter(125)
P_MLOC_MaxWheelslip_perc = Simulink.Parameter(300, Min=0)
P_MLOC_MaxWheelslipangle_rad = Simulink.Parameter(1.570796, Min=0)
P_MLOC_MinWheelslip_perc = Simulink.Parameter(-300, Max=0)
P_MLOC_MinWheelslipangle_rad = Simulink.Parameter(-1.570796, Max=0)
P_VDC_resLim_dGPS_m = Simulink.Parameter(10)
P_VDC_resLim_dVLOC_m = Simulink.Parameter(10)
P_VDC_resLim_psiGPS_rad = Simulink.Parameter(0.5)
P_VDC_resLim_sGPS_m = Simulink.Parameter(20)
P_VDC_resLim_sVLOC_m = Simulink.Parameter(200)
P_VDC_resLim_vx_mps = Simulink.Parameter(50)
P_VDC_resLim_vy_mps = Simulink.Parameter(20)
P_VDC_resLim_psiVLOC_rad = Simulink.Parameter(0.5)
P_VDC_LowPassT1Curvature = Simulink.Parameter(0.06)
P_VDC_CurvatureEstimateMax_radpm = Simulink.Parameter(0.3)
P_VDC_CurvatureEstimationMode = Simulink.Parameter(1)