% Simulink data dictionary pa_mvdc_KF.sldd

P_VDC_ManualInitializationStartPose = Simulink.Parameter([0 0 0])
P_VDC_ManualInitializationStateEstimation = Simulink.Parameter(false, DataType="boolean")

P_VDC_EnableTrackDepCov = Simulink.Parameter(1)  % 1 : EKF Version 1
  % 2 : EKF Version 2

P_VDC_measCov_velocity = Simulink.Parameter([0.0593 0.0577])  % Measurement Noise Covariance "Vector":
  % [var(vx); var(vy)]
  % Petrovski (10.04.2018)
  % var(vx) = 0.0593
  % var(vy) = 0.0577

P_VDC_Var_ay_mps2 = Simulink.Parameter(0.8)  % Variance of ay_mps2
  % Petrovski - 16.04.2018
  % 1.5279  [m/s^2]

P_VDC_Var_ax_mps2 = Simulink.Parameter(0.5)  % Variance of ax_mps2
  % Petrovski - 10.04.2018
  % 1.2328

P_VDC_OutlierBounds = Simulink.Parameter(5)
P_VDC_EnableInputCrossCorrelation = Simulink.Parameter(true, DataType="boolean")

P_VDC_Var_yawRate_radps = Simulink.Parameter(0.0001)  % Variance of yawRate_radps / dPsi_radps
  % Petrovski - 16.04.2018
  % 0.0005 [rad/s]

P_VDC_measCov_GPS = Simulink.Parameter([0.05 0.05 0.002])  % Measurement Noise Covariance
P_VDC_measCov_VLOC = Simulink.Parameter([0.05 0.05 0.004])  % Measurement Noise Covariance
P_VDC_YawAngleDepCovMode = Simulink.Parameter(0)