% Simulink data dictionary pa_mvdc_KF_PointMassJoint.sldd

P_VDC_ManualInitializationStartPose = Simulink.Parameter([0 0 0])
P_VDC_ManualInitializationStateEstimation = Simulink.Parameter(false, DataType="boolean")
P_VDC_EnableInputCrossCorrelation = Simulink.Parameter(true, DataType="boolean")
P_VDC_YawAngleDepCovMode = Simulink.Parameter(0)
P_VDC_resLim_psiLoc1_rad = Simulink.Parameter(0.2)
P_VDC_resLim_psiLoc2_rad = Simulink.Parameter(0.2)
P_VDC_resLim_vxVel1_mps = Simulink.Parameter(0.4)
P_VDC_resLim_vxVel2_mps = Simulink.Parameter(0.4)
P_VDC_resLim_vyVel1_mps = Simulink.Parameter(0.4)
P_VDC_resLim_vyVel2_mps = Simulink.Parameter(0.4)
P_VDC_resLim_xLoc1_m = Simulink.Parameter(0.8)
P_VDC_resLim_xLoc2_m = Simulink.Parameter(0.8)
P_VDC_resLim_yLoc1_m = Simulink.Parameter(0.8)
P_VDC_resLim_yLoc2_m = Simulink.Parameter(0.8)
P_VDC_ResFilterSamples = Simulink.Parameter(25)
P_VDC_InputCov = Simulink.Parameter([0.0001 0.5 0.8])
P_VDC_LPStateEstimationIMU_s = Simulink.Parameter(0.01)
P_VDC_ManualInitialization_v0 = Simulink.Parameter(0)
P_VDC_ManualInitializationStartVelocity = Simulink.Parameter(false, DataType="boolean")
P_VDC_resLim_psiLoc3_rad = Simulink.Parameter(0.2)
P_VDC_resLim_xLoc3_m = Simulink.Parameter(0.8)
P_VDC_resLim_yLoc3_m = Simulink.Parameter(0.8)
P_VDC_OutlierBounds = Simulink.Parameter([2 2 0.3 2 2 0.3 2 2 0.3 2 1 2 1])
P_VDC_MeasCov = Simulink.Parameter([0.01 0.01 0.001 0.1 0.1 0.01 0.1 0.1 0.01 0.05 0.05 0.1 0.1])
P_VDC_EnableBankingCompStateEst_b = Simulink.Parameter(true, DataType="boolean")
P_VDC_StateEstimator_InvalidTime_s = Simulink.Parameter(1)