% Simulink data dictionary pa_mvdc_state_estimation.sldd

P_VDC_deactivateEKF = Simulink.Parameter(0, DataType="boolean", Min=0, Max=1)  % Deactivate EKF : =1
  % Activate EKF : =0

P_MLOC_MaxPosVLOC_x_m = Simulink.Parameter(5000, Min=0)
P_MLOC_MaxPosVLOC_y_m = Simulink.Parameter(5000, Min=0)
P_MLOC_MaxPsiVLOC_rad = Simulink.Parameter(3.141593, Min=0)
P_MLOC_MinPosVLOC_x_m = Simulink.Parameter(-5000, Max=0)
P_MLOC_MinPosVLOC_y_m = Simulink.Parameter(-5000, Max=0)
P_MLOC_MinPsiVLOC_rad = Simulink.Parameter(-3.141593, Max=0)
P_MLOC_VLOCDelayCompTime_s = Simulink.Parameter(0.04)
P_MLOC_UseVLOCDelayCompensation = Simulink.Parameter(true, DataType="boolean")
KalmanFilterMode = Simulink.Parameter(0)

P_VDC_LocalizationMode = Simulink.Parameter(0, DataType="uint16")  % 0 = GPS Only
  % 1 = GPS and AMCL
  % 2 = AMCL only