% Simulink data dictionary pa_mloc_diag_vehicle.sldd

P_MLOC_KappaDistResponsiveMax_radpm = Simulink.Parameter(0.15, Min=0)
P_MLOC_axDistResponsiveMax_mps2 = Simulink.Parameter(10, Min=0)
P_MLOC_SafeStandstill_FMax_N = Simulink.Parameter(-1000)
P_MLOC_SafeStandstill_vabsMax_mps = Simulink.Parameter(0.8)
P_MLOC_ActivateVehicleUnresponsiveDetection_b = Simulink.Parameter(false, DataType="boolean")
P_MLOC_ActivateVehicleUnstableDetection_b = Simulink.Parameter(true, DataType="boolean")
P_MLOC_BetaMax_rad = Simulink.Parameter(0.3, Min=0)