% Simulink data dictionary RaptorStateMachine.sldd
% references modelconfig.sldd
% references simulation_modelconfig.sldd

EcAck = enum(DefaultValue="EcAck0_None")
  EcAck0_None = 0
  EcAck1_PowerOnStage1Check = 1
  EcAck2_PowerOnStage1Pass = 2
  EcAck3_PowerOnStage2Check = 3
  EcAck4_PowerOnStage2Pass = 4
  EcAck5_PowerOffStage1Check = 5
  EcAck6_PowerOffStage1Pass = 6
  EcAck7_PowerOffStage2Check = 7
  EcAck8_PowerOffStage2Pass = 8

VdFcn = enum(DefaultValue="VdFcn0_None")
  VdFcn0_None = 0
  VdFcn1_Hb = 1
  VdFcn2_ActuationTest = 2
  VdFcn3_HoldBrakes = 3
  VdFcn4_FullDbwControlToCt = 4
  VdFcn5_Shutdown = 5
  VdFcn6_PurpleFlagActions = 6

VdFaults = enum(DefaultValue="NoStaticFaults")
  NoStaticFaults = 0
  ConnectAttemptFail = 1
  ActuationTestFail = 2
  UnableToHoldBrakes = 3
  PowerOffFailed = 4
  NoDrivingFaults = 5
  F_BrakePrsOutOfRange = 6
  R_BrakePrsOutOfRange = 7
  DbwEcuFault = 8
  BothBrakesOutOfRangeAndEcuFault = 9
  BothBrakesOutOfRange = 10
  F_BrakePrsOutOfRangeAndEcuFault = 11
  R_BrakePrsOutOfRangeAndEcuFault = 12

VdAck = enum(DefaultValue="VdAck0_None")
  VdAck0_None = 0
  VdAck1_Default = 1
  VdAck2_VdEstablishConnectionsAttempt = 2
  VdAck3_VdEstablishConnectionsSuccess = 3
  VdAck4_ActuationTestAttempt = 4
  VdAck5_ActuationTestSuccess = 5
  VdAck6_HoldBrakesForCrankOrShutDown = 6
  VdAck7_CtSteerBrakeControl = 7
  VdAck8_BringToStopSuccess = 8
  VdAck9_VDPowerOff = 9
  VdAck10_ActuationTestFail = 10
  VdAck11_InitiateEmergencyActions = 11
  VdAck12_EmergencyActionsComplete = 12
  VdAck13_VDPowerOffComplete = 13

ToggleSwitch = enum(DefaultValue="TestMode")
  TestMode = 1
  RaceMode = 2

SystemStates = enum(DefaultValue="None")
  None = 0
  SS255_Default = 255
  SS1_PowerOn = 1
  SS2_EstConn = 2
  SS3_ActTest = 3
  SS4_ActTestPass = 4
  SS5_WaitToCrank = 5
  SS6_CrankChecksPassed = 6
  SS7_Crank = 7
  SS8_EngineIdle = 8
  SS9_Driving = 9
  SS10_ShutEngine = 10
  SS11_PowerOff = 11
  SS12_RaptorOff = 12
  SS13_CrankCheckInit = 13
  SS14_ActTestFail = 14
  SS15_CrankChecksFailed = 15
  SS16_EmgShutDown = 16
  SS17_EngineFailedToStart = 17
  SS18_CriticalLimitExceeded = 18

RcAck = enum(DefaultValue="RcAck0_None")
  RcAck0_None = 0
  RcAck1_RcFound = 1
  RcAck2_RcCheckOrangeFlag = 2
  RcAck3_RcCheckYellowGreenFlag = 3
  RcAck4_RcMovingChecks = 4

PtAck = enum(DefaultValue="PtAck0_None")
  PtAck0_None = 0
  PtAck1_Default = 1
  PtAck2_PtEstablishConnectionsAttempt = 2
  PtAck3_PtEstablishConnectionsSuccess = 3
  PtAck4_PtPreCrankChecksAttempt = 4
  PtAck5_PtPreCrankCheckSuccess = 5
  PtAck6_FireEngineAttempt = 6
  PtAck7_FireEngineSuccess = 7
  PtAck8_EngineIdle = 8
  PtAck9_ThrottleControlToCT = 9
  PtAck10_EngineOffInitiated1 = 10
  PtAck11_EngineOffSuccesful = 11
  PtAck12_PtPreCrankCheckFail = 12
  PtAck13_FireEngineFail = 13

EcFcn = enum(DefaultValue="EcFcn0_None")
  EcFcn0_None = 0
  EcFcn1_PowerOnStage1Check = 1
  EcFcn2_PowerOnStage2 = 2
  EcFcn3_PowerOffStage1 = 3
  EcFcn4_PowerOffStage2 = 4

CtAck = enum(DefaultValue="CtAck0_CtNotInitialized")
  CtAck0_CtNotInitialized = 0
  CtAck1_EstablishingConnectionToCt = 1
  CtAck2_CtOnline = 2
  CtAck3_CtControlSuspended = 3

CtMode = enum(DefaultValue="CtMode0_Uninitialized")
  CtMode0_Uninitialized = 0
  CtMode1_PwrOn = 1
  CtMode2_Initialized = 2
  CtMode3_ActTest = 3
  CtMode4_CrankReady = 4
  CtMode5_StartEngineNow = 5
  CtMOde6_RaceReady = 6
  CtMode7_InitDriving = 7
  CtMode8_Caution = 8
  CtMode9_NomRace = 9
  CtMode10_CoordStop = 10
  CtMode11_CntrlShudown = 11
  CtMode12_EmrgShutdown = 12
  CtMode255_Default = 255

SafetySwitch = enum(DefaultValue="Processing")
  Processing = 0
  SafetySwitchPos1 = 1
  SafetySwitchPos2 = 2
  SafetySwitchPos3 = 3
  SafetySwitchPos4 = 4
  SafetySwitchPos0 = 5
  SafetySwitchPosFault = 6