% Simulink data dictionary TrajectoryPlanningEmulation.sldd
% references modelconfig.sldd
% references TUM_interfaces.sldd
% references ScenarioDefinition.sldd

P_PX2_EnterIdle_mps = Simulink.Parameter(2)
ActivateTP_PX2 = Simulink.Parameter(true, DataType="boolean")
P_TP_a_p_Emergency = Simulink.Parameter(1)
P_TP_ax_max_Emergency_mps2 = Simulink.Parameter(13.3)
P_TP_ay_max_Emergency_mps2 = Simulink.Parameter(13.3)
P_PX2_VirtualDelay_s = Simulink.Parameter(0.032)
P_VDC_VirtualScaleFactor = Simulink.Parameter(0.8)