% Simulink data dictionary sil_networkconfig.sldd

GWIP_1 = 10
GWIP_2 = 0
GWIP_3 = 0
GWIP_4 = 1
RREth_PCIBus = 2
RREth_PCISlot = 0
SGRRIP_2 = 0
SGRRIP_3 = 0
SGTeamsIP_1 = 10
SpeedGoatCANIOSlot = [8 4]
SpeedGoatCANIOSlot2 = [7 6]
TeamsEth_PCIBus = 3
TeamsEth_PCISlot = 0
EnvSim_IP_1 = 10
EnvSim_IP_2 = 162
EnvSim_IP_3 = 44
EnvSim_IP_4 = 56
VehiclePhysicsSim_IP_1 = 10
VehiclePhysicsSim_IP_2 = 162
VehiclePhysicsSim_IP_3 = 45
VehiclePhysicsSim_IP_4 = 106
PX2_Perception_IP_1 = 127
PX2_Perception_IP_2 = 0
PX2_Perception_IP_3 = 0
PX2_Perception_IP_4 = 1
PX2_Strategy_IP_1 = 127
PX2_Strategy_IP_2 = 0
PX2_Strategy_IP_3 = 0
PX2_Strategy_IP_4 = 1
SGTeamsIP_2 = 0
SGTeamsIP_3 = 0
SGTeamsIP_4 = 5
SGRRIP_1 = 10
SGRRIP_4 = 4
V2X_IP_1 = 127
V2X_IP_2 = 0
V2X_IP_3 = 0
V2X_IP_4 = 1