% Simulink data dictionary Berlin2019.sldd

Raceline = struct(
  s_m=[0; 1.9984188; 3.9968375; 5.9952563; 7.993675; 9.9920938; 11.9905125; 13.9889313; 15.9873501; 17.9857688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 6158],
  x_m=[215.4106347; 216.7944921; 218.1784395; 219.562487; 220.9466366; 222.3309054; 223.7153035; 225.099832; 226.4845089; 227.8693442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 0],
  y_m=[5.7480718; 7.1898079; 8.6314619; 10.073025; 11.51448; 12.9558254; 14.3970523; 15.8381428; 17.2790962; 18.7199037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 0],
  psi_rad=[-0.764889; -0.7649466; -0.7650109; -0.7650819; -0.7651596; -0.7652439; -0.765335; -0.7654327; -0.7655371; -0.7656482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 0],
  kappa_radpm=[-2.72e-5; -3.05e-5; -3.38e-5; -3.72e-5; -4.05e-5; -4.39e-5; -4.72e-5; -5.06e-5; -5.39e-5; -5.73e-5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 0],
  vx_mps=[42.4102556; 42.5841867; 42.7563941; 42.9269085; 43.09576; 43.2629775; 43.4285894; 43.5926231; 43.7551053; 43.9160623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 0],
  ax_mps2=[3.698718; 3.6769767; 3.6554507; 3.6341364; 3.61303; 3.5921278; 3.5714263; 3.5509221; 3.5306118; 3.5104922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 0],
  delta_rad=repmat(0, 5000, 1),
  F_N=repmat(0, 5000, 1),
  ValidPointCnt=1160,
  s_m_end=2316.1673391)

Raceline_Op1 = struct(
  s_m=[0; 1.9984188; 3.9968375; 5.9952563; 7.993675; 9.9920938; 11.9905125; 13.9889313; 15.9873501; 17.9857688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 6158],
  x_m=[215.4106347; 216.7944921; 218.1784395; 219.562487; 220.9466366; 222.3309054; 223.7153035; 225.099832; 226.4845089; 227.8693442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 0],
  y_m=[5.7480718; 7.1898079; 8.6314619; 10.073025; 11.51448; 12.9558254; 14.3970523; 15.8381428; 17.2790962; 18.7199037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 0],
  psi_rad=[-0.764889; -0.7649466; -0.7650109; -0.7650819; -0.7651596; -0.7652439; -0.765335; -0.7654327; -0.7655371; -0.7656482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 0],
  kappa_radpm=[-2.72e-5; -3.05e-5; -3.38e-5; -3.72e-5; -4.05e-5; -4.39e-5; -4.72e-5; -5.06e-5; -5.39e-5; -5.73e-5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 0],
  vx_mps=[42.4102556; 42.5841867; 42.7563941; 42.9269085; 43.09576; 43.2629775; 43.4285894; 43.5926231; 43.7551053; 43.9160623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 0],
  ax_mps2=[3.698718; 3.6769767; 3.6554507; 3.6341364; 3.61303; 3.5921278; 3.5714263; 3.5509221; 3.5306118; 3.5104922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 0],
  delta_rad=repmat(0, 5000, 1),
  F_N=repmat(0, 5000, 1),
  ValidPointCnt=1160,
  s_m_end=2316.1673391)

Raceline_Op2 = struct(
  s_m=[0; 1.9984188; 3.9968375; 5.9952563; 7.993675; 9.9920938; 11.9905125; 13.9889313; 15.9873501; 17.9857688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 6158],
  x_m=[215.4106347; 216.7944921; 218.1784395; 219.562487; 220.9466366; 222.3309054; 223.7153035; 225.099832; 226.4845089; 227.8693442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 0],
  y_m=[5.7480718; 7.1898079; 8.6314619; 10.073025; 11.51448; 12.9558254; 14.3970523; 15.8381428; 17.2790962; 18.7199037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 0],
  psi_rad=[-0.764889; -0.7649466; -0.7650109; -0.7650819; -0.7651596; -0.7652439; -0.765335; -0.7654327; -0.7655371; -0.7656482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 0],
  kappa_radpm=[-2.72e-5; -3.05e-5; -3.38e-5; -3.72e-5; -4.05e-5; -4.39e-5; -4.72e-5; -5.06e-5; -5.39e-5; -5.73e-5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 0],
  vx_mps=[42.4102556; 42.5841867; 42.7563941; 42.9269085; 43.09576; 43.2629775; 43.4285894; 43.5926231; 43.7551053; 43.9160623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 0],
  ax_mps2=[3.698718; 3.6769767; 3.6554507; 3.6341364; 3.61303; 3.5921278; 3.5714263; 3.5509221; 3.5306118; 3.5104922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 0],
  delta_rad=repmat(0, 5000, 1),
  F_N=repmat(0, 5000, 1),
  ValidPointCnt=1160,
  s_m_end=2316.1673391)

s0_m_Op1 = 10
s0_m_Op2 = 20
s0_m_Op3 = 30
s0_m_Op4 = 40
velGain_Op1 = 0
velGain_Op2 = 0
velGain_Op3 = 0
velGain_Op4 = 0
x0_vehiclepose_stm = [215.4106347 5.7480718 -0.764889]
x0_vehiclepose_Op1 = [215.4106347 5.7480718 -0.764889]
x0_vehiclepose_Op2 = [215.4106347 5.7480718 -0.764889]
x0_vehiclepose_Op3 = [215.4106347 5.7480718 -0.764889]
x0_vehiclepose_Op4 = [215.4106347 5.7480718 -0.764889]
x0_vehiclepose_dtm = [215.4106347 -5.7480718 0 0 0 -0.8059073]