% Simulink data dictionary Modena.sldd

Raceline = struct(
  s_m=[0; 1.999551; 3.9991019; 5.9986529; 7.9982039; 9.9977548; 11.9973058; 13.9968567; 15.9964077; 17.9959587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 5999],
  x_m=[143.649175; 145.2516176; 146.8539832; 148.4562807; 150.0585203; 151.6607107; 153.2628604; 154.8649814; 156.4670809; 158.0691674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 0],
  y_m=[-130.6271931; -131.8231786; -133.0192678; -134.2154477; -135.4117062; -136.6080303; -137.8044069; -139.0008253; -140.1972711; -141.3937314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 0],
  psi_rad=[-2.2119235; -2.2119919; -2.2120526; -2.2121054; -2.2121503; -2.2121874; -2.2122166; -2.2122381; -2.2122516; -2.2122573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 0],
  kappa_radpm=[-3.62e-5; -3.23e-5; -2.84e-5; -2.44e-5; -2.05e-5; -1.66e-5; -1.27e-5; -8.7e-6; -4.8e-6; -9.0e-7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 0],
  vx_mps=[55.470875; 55.5282535; 55.5852115; 55.641753; 55.6978818; 55.753602; 55.8089171; 55.8638309; 55.9183472; 55.9724696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 0],
  ax_mps2=[1.5925969; 1.5825556; 1.572588; 1.5626932; 1.5528707; 1.5431197; 1.5334395; 1.5238296; 1.5142892; -6.3786448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 0],
  delta_rad=repmat(0, 5000, 1),
  F_N=repmat(0, 5000, 1),
  ValidPointCnt=1000,
  s_m_end=1997.5514127)

Raceline_Op1 = struct(
  s_m=[0; 1.999551; 3.9991019; 5.9986529; 7.9982039; 9.9977548; 11.9973058; 13.9968567; 15.9964077; 17.9959587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 5999],
  x_m=[143.649175; 145.2516176; 146.8539832; 148.4562807; 150.0585203; 151.6607107; 153.2628604; 154.8649814; 156.4670809; 158.0691674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 0],
  y_m=[-130.6271931; -131.8231786; -133.0192678; -134.2154477; -135.4117062; -136.6080303; -137.8044069; -139.0008253; -140.1972711; -141.3937314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 0],
  psi_rad=[-2.2119235; -2.2119919; -2.2120526; -2.2121054; -2.2121503; -2.2121874; -2.2122166; -2.2122381; -2.2122516; -2.2122573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 0],
  kappa_radpm=[-3.62e-5; -3.23e-5; -2.84e-5; -2.44e-5; -2.05e-5; -1.66e-5; -1.27e-5; -8.7e-6; -4.8e-6; -9.0e-7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 0],
  vx_mps=[55.470875; 55.5282535; 55.5852115; 55.641753; 55.6978818; 55.753602; 55.8089171; 55.8638309; 55.9183472; 55.9724696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 0],
  ax_mps2=[1.5925969; 1.5825556; 1.572588; 1.5626932; 1.5528707; 1.5431197; 1.5334395; 1.5238296; 1.5142892; -6.3786448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 0],
  delta_rad=repmat(0, 5000, 1),
  F_N=repmat(0, 5000, 1),
  ValidPointCnt=1000,
  s_m_end=1997.5514127)

Raceline_Op2 = struct(
  s_m=[0; 1.999551; 3.9991019; 5.9986529; 7.9982039; 9.9977548; 11.9973058; 13.9968567; 15.9964077; 17.9959587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 5999],
  x_m=[143.649175; 145.2516176; 146.8539832; 148.4562807; 150.0585203; 151.6607107; 153.2628604; 154.8649814; 156.4670809; 158.0691674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 0],
  y_m=[-130.6271931; -131.8231786; -133.0192678; -134.2154477; -135.4117062; -136.6080303; -137.8044069; -139.0008253; -140.1972711; -141.3937314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 0],
  psi_rad=[-2.2119235; -2.2119919; -2.2120526; -2.2121054; -2.2121503; -2.2121874; -2.2122166; -2.2122381; -2.2122516; -2.2122573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 0],
  kappa_radpm=[-3.62e-5; -3.23e-5; -2.84e-5; -2.44e-5; -2.05e-5; -1.66e-5; -1.27e-5; -8.7e-6; -4.8e-6; -9.0e-7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 0],
  vx_mps=[55.470875; 55.5282535; 55.5852115; 55.641753; 55.6978818; 55.753602; 55.8089171; 55.8638309; 55.9183472; 55.9724696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 0],
  ax_mps2=[1.5925969; 1.5825556; 1.572588; 1.5626932; 1.5528707; 1.5431197; 1.5334395; 1.5238296; 1.5142892; -6.3786448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 0],
  delta_rad=repmat(0, 5000, 1),
  F_N=repmat(0, 5000, 1),
  ValidPointCnt=1000,
  s_m_end=1997.5514127)

s0_m_Op1 = 10
s0_m_Op2 = 20
s0_m_Op3 = 30
s0_m_Op4 = 40
velGain_Op1 = 0
velGain_Op2 = 0
velGain_Op3 = 0
velGain_Op4 = 0
x0_vehiclepose_stm = [143.649175 -130.6271931 -2.2119235]
x0_vehiclepose_Op1 = [143.649175 -130.6271931 -2.2119235]
x0_vehiclepose_Op2 = [143.649175 -130.6271931 -2.2119235]
x0_vehiclepose_Op3 = [143.649175 -130.6271931 -2.2119235]
x0_vehiclepose_Op4 = [143.649175 -130.6271931 -2.2119235]
x0_vehiclepose_dtm = [143.649175 130.6271931 0 0 0 0.6411272]