% Simulink data dictionary Monteblanco2019_track.sldd

Raceline = struct(
  s_m=[0; 1.9984384; 3.9968768; 5.9953152; 7.9937536; 9.992192; 11.9906304; 13.9890688; 15.9875071; 17.9859455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 6190],
  x_m=[-20.0818411; -18.6931257; -17.3055042; -15.9189015; -14.5331702; -13.1483204; -11.7642768; -10.3809038; -8.9981996; -7.6160891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 0],
  y_m=[221.2036277; 219.7664798; 218.3283379; 216.8892647; 215.4492473; 214.0084364; 212.5668937; 211.1246182; 209.6817479; 208.2383444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 0],
  psi_rad=[-2.372946; -2.3737096; -2.3744244; -2.3750906; -2.375708; -2.3762769; -2.3767972; -2.377269; -2.3776923; -2.3780672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 0],
  kappa_radpm=[-0.0003943; -0.0003699; -0.0003455; -0.0003211; -0.0002968; -0.0002725; -0.0002482; -0.0002239; -0.0001997; -0.0001755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 0],
  vx_mps=[50.7053647; 50.7996389; 50.8931832; 50.9860059; 51.0781152; 51.169519; 51.2602254; 51.350242; 51.4395765; 51.5282365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 0],
  ax_mps2=[2.3941953; 2.3800542; 2.3660225; 2.3520991; 2.3382827; 2.3245721; 2.3109662; 2.2974637; 2.2840635; 2.2707645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 0],
  delta_rad=repmat(0, 5000, 1),
  F_N=repmat(0, 5000, 1),
  ValidPointCnt=1192,
  s_m_end=2380.1401264)

Raceline_Op1 = struct(
  s_m=[0; 1.9984384; 3.9968768; 5.9953152; 7.9937536; 9.992192; 11.9906304; 13.9890688; 15.9875071; 17.9859455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 6190],
  x_m=[-20.0818411; -18.6931257; -17.3055042; -15.9189015; -14.5331702; -13.1483204; -11.7642768; -10.3809038; -8.9981996; -7.6160891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 0],
  y_m=[221.2036277; 219.7664798; 218.3283379; 216.8892647; 215.4492473; 214.0084364; 212.5668937; 211.1246182; 209.6817479; 208.2383444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 0],
  psi_rad=[-2.372946; -2.3737096; -2.3744244; -2.3750906; -2.375708; -2.3762769; -2.3767972; -2.377269; -2.3776923; -2.3780672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 0],
  kappa_radpm=[-0.0003943; -0.0003699; -0.0003455; -0.0003211; -0.0002968; -0.0002725; -0.0002482; -0.0002239; -0.0001997; -0.0001755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 0],
  vx_mps=[50.7053647; 50.7996389; 50.8931832; 50.9860059; 51.0781152; 51.169519; 51.2602254; 51.350242; 51.4395765; 51.5282365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 0],
  ax_mps2=[2.3941953; 2.3800542; 2.3660225; 2.3520991; 2.3382827; 2.3245721; 2.3109662; 2.2974637; 2.2840635; 2.2707645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 0],
  delta_rad=repmat(0, 5000, 1),
  F_N=repmat(0, 5000, 1),
  ValidPointCnt=1192,
  s_m_end=2380.1401264)

Raceline_Op2 = struct(
  s_m=[0; 1.9984384; 3.9968768; 5.9953152; 7.9937536; 9.992192; 11.9906304; 13.9890688; 15.9875071; 17.9859455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 6190],
  x_m=[-20.0818411; -18.6931257; -17.3055042; -15.9189015; -14.5331702; -13.1483204; -11.7642768; -10.3809038; -8.9981996; -7.6160891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 0],
  y_m=[221.2036277; 219.7664798; 218.3283379; 216.8892647; 215.4492473; 214.0084364; 212.5668937; 211.1246182; 209.6817479; 208.2383444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 0],
  psi_rad=[-2.372946; -2.3737096; -2.3744244; -2.3750906; -2.375708; -2.3762769; -2.3767972; -2.377269; -2.3776923; -2.3780672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 0],
  kappa_radpm=[-0.0003943; -0.0003699; -0.0003455; -0.0003211; -0.0002968; -0.0002725; -0.0002482; -0.0002239; -0.0001997; -0.0001755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 0],
  vx_mps=[50.7053647; 50.7996389; 50.8931832; 50.9860059; 51.0781152; 51.169519; 51.2602254; 51.350242; 51.4395765; 51.5282365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 0],
  ax_mps2=[2.3941953; 2.3800542; 2.3660225; 2.3520991; 2.3382827; 2.3245721; 2.3109662; 2.2974637; 2.2840635; 2.2707645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 0],
  delta_rad=repmat(0, 5000, 1),
  F_N=repmat(0, 5000, 1),
  ValidPointCnt=1192,
  s_m_end=2380.1401264)

s0_m_Op1 = 10
s0_m_Op2 = 20
s0_m_Op3 = 30
s0_m_Op4 = 40
velGain_Op1 = 0
velGain_Op2 = 0
velGain_Op3 = 0
velGain_Op4 = 0
x0_vehiclepose_stm = [-20.0818411 221.2036277 -2.372946]
x0_vehiclepose_Op1 = [-20.0818411 221.2036277 -2.372946]
x0_vehiclepose_Op2 = [-20.0818411 221.2036277 -2.372946]
x0_vehiclepose_Op3 = [-20.0818411 221.2036277 -2.372946]
x0_vehiclepose_Op4 = [-20.0818411 221.2036277 -2.372946]
x0_vehiclepose_dtm = [-20.0818411 -221.2036277 0 0 0 0.8021497]